# Grasshopper definition Cheese.gh (Grasshopper 1.0.8)

length = Slider(6, range=1..10)
height = Slider(1, range=1..4)
width = Slider(5, range=1..10)
density = Slider(0.1, range=0.1..1)
width_2 = GetInteger(width, AtLeast=1, AtMost=1, Maximum=2147483647, Minimum=-2147483648, TreeAccess=False)
length_2 = GetInteger(length, AtLeast=1, AtMost=1, Maximum=2147483647, Minimum=-2147483648, TreeAccess=False)
density_2 = GetNumber(density, AtLeast=1, AtMost=1, Maximum=1.797693135e+308, Minimum=-1.797693135e+308, TreeAccess=False)
height_2 = GetInteger(height, AtLeast=1, AtMost=1, Maximum=2147483647, Minimum=-2147483648, TreeAccess=False)
rectangle = Rectangle(Plane=PlaneXY(0, 0, 0), XSize=width_2, YSize=length_2, Radius=0)  # -> Rectangle, Length
multiplication = Multiplication(A=width_2, B=length_2)
multiplication_2 = Multiplication(A=multiplication, B=density_2)
srf = Surface(rectangle.Rectangle)
round = Round(Number=multiplication_2)  # -> Nearest, Floor, Ceiling
popgeo = PopulateGeometry(Geometry=srf, Count=round.Nearest, Seed=1)
cir = Circle(Plane=popgeo, Radius=0.4)
rdiff = RegionDifference(CurvesA=srf, CurvesB=cir)
boundary = BoundarySurfaces(Edges=rdiff)
Z = UnitZ(Factor=height_2)
extr = Extrude(Base=boundary, Direction=Z)
context_bake = ContextBake(Geometry=extr)
