# Grasshopper definition Cheese_Hops.gh (Grasshopper 1.0.8)
# plug-ins: Hops

hops = Hops(
    Width=Slider(8, range=0..10),
    Length=Slider(8, range=0..10),
    Height=Slider(0.5, range=0..1),
    Density=Slider(3, range=0..10),
    CacheResultsInMemory=True,
    CacheSolveResults=True,
    RemoteDefinitionLocation="C:\Users\joaqu\Downloads\Cheese.gh",
    RemoteSolveVersion=(0, 1, 0),
    ShowInput_Enabled=False,
    ShowInput_Path=False,
    SynchronousSolve=True)
